vi "Adquirir posição cursores.gviweb"   [LabVIEW NXG 5.0.0]
inputs:
  "Input": "Graph reference"
  "selector": error
outputs:
  "Posição cursor 0": f64
  "Output": error
  "Posição cursor 1": f64
diagram:
  case ($selector) {
    frame Error, Default {
      w1 = $selector
    }
    frame No Error {
      Property Node(instance in=$Input, "ActiveCursor"=0, "ActiveCursor"=1) -> ("Cursor"=w2, "Cursor"=w3, error out=w4)
      Property Node(instance in=w2, error in=w4) -> ("XPosition"=w5, error out=w6)
      $"Posição cursor 0" <- w5
      Property Node(instance in=w3, error in=w6) -> ("XPosition"=w7, error out=w1)
      $"Posição cursor 1" <- w7
    }
  }
  $Output <- w1
