vi "Function.gviweb"   [LabVIEW NXG 5.0.0]
inputs:
  "Input_2": "Graph reference"
  "ActiveCursor_2": i32
  "ActiveCursor": i32 = 1
  "Input": error
outputs:
  "Posição cursor 0": f64
  "Posição cursor 1": f64
  "Output": error
diagram:
  case ($Input) {
    frame Error, Default {
      w1 = $Input
    }
    frame No Error {
      Property Node(instance in=$Input_2, "ActiveCursor"=$ActiveCursor_2, "ActiveCursor"=$ActiveCursor, error in=$Input) -> ("Cursor"=w2, "Cursor"=w3, error out=w4)
      Property Node(instance in=w2, error in=w4) -> ("XPosition"=w5, error out=w6)
      $"Posição cursor 0" <- w5
      Property Node(instance in=w3, error in=w6) -> ("XPosition"=w7, error out=w1)
      $"Posição cursor 1" <- w7
    }
  }
  $Output <- w1
