vi "Function_2.gviweb"   [LabVIEW NXG 5.0.0]
inputs:
  "Input": "Graph reference"
  "Input_2": error
outputs:
  "Posição cursor 0": f64
  "Posição cursor 1": f64
  "Output": error
diagram:
  case ($Input_2) {
    frame Error, Default {
      w1 = $Input_2
    }
    frame No Error {
      Property Node(instance in=$Input, "ActiveCursor"=0, "ActiveCursor"=1) -> ("Cursor"=w2, "Cursor"=w3, error out=w4)
      Property Node(instance in=w2, error in=w4) -> ("XPosition"=w5, error out=w6)
      $"Posição cursor 0" <- w5
      Property Node(instance in=w3, error in=w6) -> ("XPosition"=w7, error out=w1)
      $"Posição cursor 1" <- w7
    }
  }
  $Output <- w1
