vi "Gerador de sinais.gviweb"   [LabVIEW NXG 5.0.0]
panel controls:
  "Amplitude": f64 = 5
  "Tempo": f64 = 1
  "Forma de onda": T1 = "Senoidal"
  "Offset": f64
  "Fase": f64
  "Frequência": f64 = 1
  "Razão cíclica": f64 = 50
  "Concatenar": bool
  "Concatenar entre cursores": bool
  "Deletar entre cursores": bool
  "Adquirir entre cursores": bool
  "Salvar": bool
  "Carregar": bool
panel indicators:
  "URL Image": string
  "Waveform Graph": waveform<f64>
  "Waveform Graph_2": waveform<f64>
  "error out": error
  "URL Image_2": string
  "URL Image_3": string
types:
  T1 = enum{"Senoidal", "Triangular", "Quadrada", "Dente de Serra", "Trapezoidal"}
  T2 = cluster{"Sinal": string, "Fase": f64, "Offset": f64, "Tempo": f64, "Amplitude": f64, "Frequência": f64, "Razão cíclica": f64, "Comando de edição": i32, "Posição cursor 0": f64, "Posição cursor 1": f64, "Operação com arquivo": i32, "Gráfico geração": waveform<f64>, "Gráfico edição": waveform<f64>}
uses:
  NI::HTTP::Open HTTP Handle.gvi
  WebApp::Conversor ENUM para ARRAY.gviweb
  WebApp::Adquirir posição cursores.gviweb
  NI::HTTP::GET.gvi
  WebApp::Posição cursores.gviweb
  NI::HTTP::Close HTTP Handle.gvi
diagram:
  w1 = T2 {"Tempo"=1, "Amplitude"=5, "Frequência"=1, "Razão cíclica"=50, "Gráfico geração"={dt=1, Y=[]}, "Gráfico edição"={dt=1, Y=[]}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}
  w2 = "Inicialização"  # Type
  call "Open HTTP Handle.gvi"() -> (client handle out=w3, error out=w4)
  s1 = w2  # shift register
  s2 = w1  # shift register
  s3 = w4  # shift register
  s4 = w3  # shift register
  while {
    case (s1) {
      frame "Inicialização", Default {
        disable {
          frame Enabled { }
          frame Disabled {
            Property Node(instance in=reference to "Deletar entre cursores", "Disabled"=TRUE)
            Property Node(instance in=reference to "Concatenar entre cursores", "Disabled"=TRUE)
            Property Node(instance in=reference to "Adquirir entre cursores", "Disabled"=TRUE)
          }
        }
        Property Node(instance in=reference to "Waveform Graph_2", "Value"=waveform<f64> {dt=1, Y=[]}, "ActiveCursor"=0, "ActiveCursor"=1) -> ("Cursor"=w9, "Cursor"=w10)
        Property Node(instance in=w9, "Visible"=FALSE)
        w11 = "Esperar por evento"  # Type
        Property Node(instance in=w10, "Visible"=FALSE)
        w5 = s2
        w6 = w11
        w7 = s4
        w8 = s3
      }
      frame "Esperar por evento" {
        event {
          on "Amplitude" Value changed; "Fase" Value changed; "Forma de onda" Value changed; "Frequência" Value changed; "Offset" Value changed; "Razão cíclica" Value changed; "Tempo" Value changed {
            call "Conversor ENUM para ARRAY.gviweb"(Forma de onda=$"Forma de onda", Error in=s3) -> (Sinal=w12, Error out=w8)
            Property Node(instance in=s2, "Tempo"=$Tempo, "Amplitude"=$Amplitude, "Fase"=$Fase, "Offset"=$Offset, "Frequência"=$Frequência, "Razão cíclica"=$"Razão cíclica", "Sinal"=w12) -> (instance out=w5)
            w13 = "Simular onda"  # Type
            w6 = w13
            w7 = s4
          }
          on "Adquirir entre cursores" Value changed; "Concatenar" Value changed; "Concatenar entre cursores" Value changed; "Deletar entre cursores" Value changed {
            Build Array($Concatenar, $"Concatenar entre cursores", $"Adquirir entre cursores", $"Deletar entre cursores") -> w14
            Boolean Array To Number(Boolean array=w14) -> (number=w15)
            call "Adquirir posição cursores.gviweb"(Input=reference to "Waveform Graph_2", selector=s3) -> (Posição cursor 0=w16, Posição cursor 1=w17, Output=w8)
            Property Node(instance in=s2, "Comando de edição"=w15, "Posição cursor 0"=w16, "Posição cursor 1"=w17) -> (instance out=w5)
            w18 = "Editar onda"  # Type
            w6 = w18
            w7 = default
          }
          on "Carregar" Value changed; "Salvar" Value changed {
            Build Array($Salvar, $Carregar) -> w19
            Boolean Array To Number(Boolean array=w19) -> (number=w20)
            Property Node(instance in=s2, "Operação com arquivo"=w20) -> (instance out=w5)
            w6 = "Salvar / Carregar onda"
            w7 = s4
            w8 = s3
          }
        }
      }
      frame "Simular onda" {
        Property Node(instance in=s2) -> ("Sinal"=w21, "Tempo"=w22, "Offset"=w23, "Amplitude"=w24, "Fase"=w25, "Frequência"=w26, "Razão cíclica"=w27, instance out=w28)
        Concatenate Strings("http://brsaolt-514zhif:9090/Gerador_WebService/", "SimularOnda") -> w29
        w30 = "?Sinal=%s&Tempo=%.2f&Offset=%.2f&Amplitude=%.2f&Fase=%.2f&Frequencia=%.2f&RazaoCiclica=%.2f"
        Format Into String(formatString=w30, initString=w29, errIn=s3, w21, w22, w23, w24, w25, w26, w27) -> (outString=w31, errOut=w32)
        call "GET.gvi"(client handle=s4, url=w31, error in=w32) -> (client handle out=w7, body=w33, error out=w34)
        Unflatten From Json(JSON string=w33, error in (no error)=w34, type and defaults=cluster{"Y": f64[], "dt": f64} {all zero or empty}) -> (error out=w8, value=w35)
        Property Node(instance in=w35) -> ("Y"=w36, "dt"=w37)
        Build Waveform Node(Y=w36, dt=w37) -> (output waveform=w38)
        Property Node(instance in=w28, "Gráfico geração"=w38) -> (instance out=w5)
        w39 = "Plotar"  # Type
        w6 = w39
      }
      frame "Posicionar cursores" {
        call "Posição cursores.gviweb"(graph in=reference to "Waveform Graph_2", Error In=s3) -> (Error Out=w8)
        $"error out" <- w8
        w40 = "Plotar"  # Type
        w5 = s2
        w6 = w40
        w7 = s4
      }
      frame "Editar onda" {
        Property Node(instance in=s2) -> ("Comando de edição"=w41, "Posição cursor 0"=w42, "Posição cursor 1"=w43, instance out=w44)
        Concatenate Strings("http://brsaolt-514zhif:9090/Gerador_WebService/", "EditarOnda") -> w45
        Format Into String(formatString="?Edicao=%d&Cursor0=%.2f&Cursor1=%.2f", initString=w45, errIn=s3, w41, w42, w43) -> (outString=w46, errOut=w47)
        call "GET.gvi"(client handle=s4, url=w46, error in=w47) -> (client handle out=w7, body=w48, error out=w49)
        Unflatten From Json(JSON string=w48, error in (no error)=w49, type and defaults=cluster{"Y": f64[], "dt": f64} {all zero or empty}) -> (error out=w8, value=w50)
        Property Node(instance in=w50) -> ("Y"=w51, "dt"=w52)
        Build Waveform Node(Y=w51, dt=w52) -> (output waveform=w53)
        Property Node(instance in=w44, "Gráfico edição"=w53) -> (instance out=w5)
        w54 = "Posicionar cursores"  # Type
        w6 = w54
      }
      frame "Salvar / Carregar onda" {
        Property Node(instance in=s2) -> ("Operação com arquivo"=w55, instance out=w56)
        Concatenate Strings("http://brsaolt-514zhif:9090/Gerador_WebService/", "Salvar_Carregar") -> w57
        Format Into String(formatString="?Operacao=%d", initString=w57, errIn=s3, w55) -> (outString=w58, errOut=w59)
        call "GET.gvi"(timeout=-1, client handle=s4, url=w58, error in=w59) -> (client handle out=w7, body=w60, error out=w61)
        Unflatten From Json(JSON string=w60, error in (no error)=w61, type and defaults=cluster{"Y": f64[], "dt": f64} {all zero or empty}) -> (error out=w8, value=w62)
        Property Node(instance in=w62) -> ("Y"=w63, "dt"=w64)
        Build Waveform Node(Y=w63, dt=w64) -> (output waveform=w65)
        Property Node(instance in=w56, "Gráfico edição"=w65) -> (instance out=w5)
        w6 = "Plotar"
      }
      frame "Plotar" {
        Property Node(instance in=s2) -> ("Gráfico geração"=w66, "Gráfico edição"=w67, instance out=w5)
        $"Waveform Graph" <- w66
        $"Waveform Graph_2" <- w67
        w6 = "Esperar por evento"
        w7 = s4
        w8 = s3
      }
    }
    Wait(time to wait=50)
    next s1 = w6
    next s2 = w5
    next s3 = w8
    next s4 = w7
    stop if FALSE
  }
  call "Close HTTP Handle.gvi"(client handle=s4, error in=s3)
