vi "Posição cursores.gviweb"   [LabVIEW NXG 5.0.0]
inputs:
  "graph in": "Graph reference"
  "Error In": error
outputs:
  "Error Out": error
panel indicators:
  "product": f64
  "product_2": f64
  "Range": cluster{"Minimum": f64, "Maximum": f64}
  "Maximum": f64
  "Waveform Graph_2": waveform<f64>
diagram:
  case ($"Error In") {
    frame Error, Default {
      w1 = $"Error In"
    }
    frame No Error {
      Property Node(instance in=$"graph in", error in=$"Error In") -> ("XScale"=w2, error out=w3)
      Property Node(instance in=w2, error in=w3) -> ("Range"=w4, error out=w5)
      $Range <- w4
      Property Node(instance in=w4) -> ("Maximum"=w6)
      $Maximum <- w6
      Multiply(w6, 0.2) -> w7
      $product <- w7
      Multiply(w6, 0.8) -> w8
      $product_2 <- w8
      Property Node(instance in=$"graph in", "ActiveCursor"=0, "ActiveCursor"=1, error in=w5) -> ("Cursor"=w9, "Cursor"=w10, error out=w11)
      Property Node(instance in=w9, "Visible"=TRUE, "XPosition"=w7, error in=w11) -> (error out=w12)
      Property Node(instance in=w10, "Visible"=TRUE, "XPosition"=w8, error in=w11) -> (error out=w13)
      Merge Errors(w12, w13) -> (error out=w1)
    }
  }
  $"Error Out" <- w1
