vi "Gerador de sinais.gviweb"   [LabVIEW NXG 5.0.0]
panel controls:
  "Amplitude": f64 = 1
  "Tempo": f64
  "Offset": f64
  "Fase": f64
  "Sinal": enum{"Sine", "Triangle", "Square", "Sawtooth"} = "Sine"
panel indicators:
  "URL Image": string
  "URL Image_2": string
  "Waveform Graph": f64[]
  "String Constant": string
types:
  T1 = cluster{"Sinal": string, "Fase": f64, "Offset": f64, "Tempo": f64, "Amplitude": f64}
uses:
  NI::HTTP::Open HTTP Handle.gvi
  NI::HTTP::GET.gvi
  NI::HTTP::Close HTTP Handle.gvi
diagram:
  w1 = "Inicialização"  # States
  call "Open HTTP Handle.gvi"() -> (client handle out=w2, error out=w3)
  s1 = w1  # shift register
  s2 = T1 {all zero or empty}  # shift register
  while {
    case (s1) {
      frame "Inicialização", Default {
        w4 = s2
        w5 = "Esperar por evento"
        w6 = w2
        w7 = w3
      }
      frame "Esperar por evento" {
        event {
          on "Amplitude" Value changed; "Fase" Value changed; "Offset" Value changed; "Sinal" Value changed; "Tempo" Value changed {
            Format Into String(formatString="%s", initString="", $Sinal) -> w8
            Property Node(instance in=s2, "Tempo"=$Tempo, "Amplitude"=$Amplitude, "Offset"=$Offset, "Fase"=$Fase, "Sinal"=w8) -> (instance out=w4)
            w5 = "Simular onda"
            w6 = w2
            w7 = w3
          }
        }
      }
      frame "Simular onda" {
        Property Node(instance in=s2) -> ("Sinal"=w9, "Tempo"=w10, "Offset"=w11, "Amplitude"=w12, "Fase"=w13)
        Format Into String(formatString="?Sinal=%s&Tempo=%.2f&Offset=%.2f&Amplitude=%.2f&Fase=%.2f", initString="http://brsaolt-514zhif:9090/Gerador_WebService/MetodoGET", w9, w10, w11, w12, w13) -> w14
        $"String Constant" <- w14
        call "GET.gvi"(client handle=w2, url=w14, error in=w3) -> (client handle out=w6, body=w15, error out=w16)
        Unflatten From Json(JSON string=w15, error in (no error)=w16, type and defaults=cluster{"Y": f64[], "dt": f64} {all zero or empty}) -> (error out=w7, value=w17)
        Property Node(instance in=w17) -> ("Y"=w18)
        $"Waveform Graph" <- w18
        w4 = s2
        w5 = "Esperar por evento"
      }
    }
    Wait(time to wait=50)
    next s1 = w5
    next s2 = w4
    stop if FALSE
  }
  call "Close HTTP Handle.gvi"(client handle=w6, error in=w7)
